# Dynamo custom node FamilyByCategory.dyf "Families by Category" (Dynamo 1.3.4.6666)
# category: Teascripts.Collections.Family
# Retrieves the families by category.

category = Input()
python_script = Python(IN[0]=category)
# ---------- python_script.python (14 lines) ----------
import sys

sys.path.append('C:/ProgramData/Dynamo/Dynamo Revit/1.3/definitions/teascripts-dynamo/')

from core import *


# data entering node
cat = UnwrapElement(IN[0])

# families by category
out = collect_families_by_category(cat)

OUT = out
# ----------------------------------------
families = Output(python_script)
